# Requirement set Communication Requirements (R2025b)

## 1 [REQ-SYS-01] Link availability
Communication shall maintain at least one active downlink path (relay or direct-to-ground) providing telemetry connectivity across every mission phase, including atmospheric entry.

## 2 [REQ-SYS-02] Downlink throughput budget
Combined downlink capacity across both paths shall meet the aggregate data rate required for real-time telemetry, video, and recorded-data playback within the mission's data budget.

## 3 [REQ-SYS-03] Communication dry mass budget
Total Communication subsystem dry mass (both terminals, C&DH, ground interface) shall not exceed the mass allocation set by the vehicle-level mass budget.

## 4 [REQ-LNK-01] Relay link margin
The relay link shall maintain positive link margin under worst-case pointing/attitude conditions across the constellation elevation-angle range used for acquisition.

## 5 [REQ-LNK-02] Direct-to-ground link margin
The direct-to-ground link shall maintain positive link margin across the vehicle's expected range and attitude envelope relative to ground stations.

## 6 [REQ-LNK-03] Regulatory EIRP / PFD compliance
Both downlink paths shall operate within FCC-authorized EIRP and power-flux-density limits for their licensed frequency bands.

## 7 [REQ-RDN-01] Reentry blackout handoff
Link management shall detect direct-to-ground link degradation during atmospheric entry and hand primary downlink responsibility to the relay path without commanded intervention.

## 8 [REQ-RDN-02] No single point of failure across paths
Loss of either the relay path or the direct-to-ground path alone shall not result in loss of all downlink or uplink capability for more than a defined maximum outage duration.

## 9 [REQ-RDN-03] Path selection determinism
Link management shall select a single authoritative uplink source when both paths are simultaneously receiving, preventing conflicting or duplicate command execution.

## 10 [REQ-CDH-01] Telemetry aggregation completeness
The telemetry aggregator shall incorporate telemetry from every subsystem interface presented to Communication — including EngineTelemetry and TankTelemetry — into the downlink stream without silent data loss.

## 11 [REQ-CDH-02] Onboard data recording depth
The data recorder shall buffer telemetry and video for at least the expected worst-case continuous coverage-gap duration without data loss.

## 12 [REQ-CDH-03] Command routing latency
Commands verified by the command decoder & router shall be delivered to GNC or Safety and Fault Management within a defined maximum latency of receipt.

## 13 [REQ-CDH-04] Video bandwidth allocation
Video capture & encoding shall constrain its output bit rate so that video does not starve telemetry bandwidth on either downlink path.

## 14 [REQ-SEC-01] Command authentication
The command decoder & router shall reject any uplinked command that fails authentication before routing it to GNC or Safety and Fault Management.

## 15 [REQ-SEC-02] Replay protection
The command decoder & router shall reject a previously-executed command received a second time, preventing unintended re-execution from a corrupted or repeated link.

## 16 [REQ-GSE-01] Pre-launch checkout throughput
The ground data interface shall support the data rate required for pre-launch subsystem checkout and telemetry playback verification within the countdown timeline.

## 17 [REQ-GSE-02] Quick-disconnect release
The vehicle-side data QD panel shall cleanly disconnect at or before liftoff without damaging vehicle-side wiring or connectors.

## 18 [REQ-CTL-01] Link health reporting
Communication shall report link status — active path, signal quality, handoff events — to Safety and Fault Management within a defined response time of a change in state.

## 19 [REQ-CTL-02] Autonomous terminal fault isolation
A failed antenna aperture, radome, or transceiver on either path shall be autonomously detected and isolated so it does not degrade the still-functioning path.

## 20 [REQ-CTL-03] EMI/EMC control
C&DH and terminal transceiver electronics shall meet conducted and radiated emissions/susceptibility limits to avoid interference with GNC, Safety, and each other's simultaneous RF operation.

## 21 [REQ-ENV-01] Antenna/radome thermal & vibroacoustic qualification
Antenna apertures and radomes shall be qualified to withstand the induced thermal and vibroacoustic environment across ascent and reentry, including maintaining RF/optical transparency through peak reentry heating so the relay antenna remains functional.