# Requirement set GNC Requirements (R2025b)

## 1 [REQ-SYS-01] Closed-loop GNC function
The GNC subsystem shall determine vehicle state, generate mission-phase guidance commands, compute control actions, and provide commands to the appropriate vehicle control-effectors through defined subsystem interfaces.

## 2 [REQ-SYS-02] Mission-phase applicability
The GNC subsystem shall provide the functions and control authority required by the defined mission phase and active vehicle stage, including distinct Booster and Ship behavior after physical separation.

## 3 [REQ-SYS-03] Control-effectors boundary
The GNC subsystem shall issue control demands through defined interfaces without assuming ownership of propulsion engines, thrust-vector actuators, RCS hardware, or aerodynamic control mechanisms owned by other subsystems.

## 4 [REQ-SYS-04] GNC state validity
The GNC subsystem shall identify when the navigation/control state is unavailable, invalid, or degraded and shall provide the resulting status to the applicable GNC mode and health-management functions.

## 5 [REQ-NAV-01] Measurement processing
NMP shall accept the defined navigation measurements, associate them with their valid timing/quality information, and provide a conditioned measurement set to the navigation estimator.

## 6 [REQ-NAV-02] Vehicle-state estimation
NSE shall estimate the vehicle state variables required by the active guidance and control functions from the available validated measurements and navigation-aiding information.

## 7 [REQ-NAV-03] Navigation aiding integration
NAI shall integrate each approved navigation-aiding source included in the architecture and shall make its information available to the state-estimation function with source validity information.

## 8 [REQ-NAV-04] Navigation integrity indication
NVI shall provide an explicit navigation validity/degraded-state indication whenever the estimated state or an input measurement set does not satisfy the defined integrity criteria for the active GNC mode.

## 9 [REQ-GDN-01] Trajectory/reference selection
GTR shall provide the active trajectory or reference definition required by the current mission phase and vehicle stage to the guidance function.

## 10 [REQ-GDN-02] Phase-dependent guidance
GPH shall generate guidance commands appropriate to the active mission phase and vehicle stage using the current estimated state and active trajectory/reference information.

## 11 [REQ-GDN-03] Guidance constraints
GCM shall apply the vehicle, mission, stage, and control-authority constraints allocated to the active guidance problem before issuing the guidance command.

## 12 [REQ-GDN-04] Guidance mode transition
GMD shall transition between defined guidance modes only when the associated vehicle-state, mission-phase, and transition conditions are satisfied.

## 13 [REQ-CTL-01] Attitude/rate control
CAT shall compute the rotational control demand required to track the commanded attitude and/or angular-rate state within the allocated control-performance limits.

## 14 [REQ-CTL-02] Translational/trajectory control
CTR shall compute the translational control demand required to track the active guidance objective within the allocated vehicle-dynamics and control-authority limits.

## 15 [REQ-CTL-03] Control-mode management
CAM shall select the applicable control regime and available control authority based on the active vehicle stage, mission phase, vehicle state, and actuator availability.

## 16 [REQ-CTL-04] Control demand limiting
CLM shall prevent the control demand passed to command allocation from exceeding the applicable validated state, vehicle, or control-authority limits.

## 17 [REQ-CMD-01] Command shaping
CAS shall transform the computed control demand into commands compatible with the defined command-interface limits, validity rules, and actuator/subsystem authority.

## 18 [REQ-CMD-02] Control allocation
CAA shall allocate each aggregate control demand to the set of control-effectors authorized and available for the active vehicle stage and mission phase.

## 19 [REQ-CMD-03] Subsystem command routing
CRS shall route each valid allocated control command to the defined receiving subsystem interface and shall identify a command as unavailable when its receiving path is not valid.

## 20 [REQ-FSW-01] GNC function execution
FEX shall execute the allocated NAV, GDN, CTL, and CMD functions with the data dependencies and execution sequencing defined by the GNC architecture.

## 21 [REQ-FSW-02] Mode-state coordination
FMG shall maintain the active GNC mode consistent with the vehicle stage, mission phase, navigation validity, control availability, and defined transition conditions.

## 22 [REQ-FSW-03] GNC data integrity and interface consistency
FDB shall maintain the defined data identity, units, timing/validity metadata, and source/destination association for GNC data exchanged among the GNC functions and external subsystem interfaces.

## 23 [REQ-FSW-04] GNC-local health response
FHM shall detect defined GNC-local health conditions and provide the resulting health/degraded-state information to the applicable GNC mode-management function and the external system-level safety/fault-management boundary.