# Requirement set Propellant Requirements (R2025b)

## 1 [REQ-SYS-01] Propellant load / delta-v margin
Total loaded propellant shall meet the mission delta-v budget with defined margin.

## 2 [REQ-SYS-02] Mixture ratio loading accuracy
Tanks shall be loadable to the target LOX:CH4 ratio within a defined tolerance, supporting Propulsion's engine mixture-ratio control.

## 3 [REQ-SYS-03] Propellant subsystem dry mass budget
Total propellant subsystem dry mass (tanks, domes, plumbing, valves) shall not exceed the vehicle-level mass allocation.

## 4 [REQ-TNK-01] Propellant containment
Tanks shall contain propellant without leakage across the full pressure/thermal range of all mission phases.

## 5 [REQ-TNK-02] Boil-off / thermal management
Tanks shall limit propellant boil-off during prelaunch hold and coast to within the venting system's capacity.

## 6 [REQ-TNK-03] Landing/header tank capacity margin
Header/landing tanks shall retain propellant margin for contingency scenarios (extended hover, divert).

## 7 [REQ-QAL-01] Tank structural strength & life
Main and header tanks shall meet metallic pressure-vessel strength and life qualification margins.

## 8 [REQ-QAL-02] Common dome load path
Common dome shall carry differential pressure and axial load between LOX and CH4 sections without failure.

## 9 [REQ-QAL-03] Downcomer/transfer tube structural integrity
CH4 transfer tube shall withstand external crush pressure from the surrounding LOX column without buckling.

## 10 [REQ-QAL-04] COPV structural qualification
Spin-start, igniter, and pneumatic actuation gas storage vessels shall meet composite overwrapped pressure vessel (COPV) safety-factor requirements.

## 11 [REQ-PRS-01] Autogenous pressurization control
System shall maintain tank ullage pressure within Propulsion's turbopump inlet/NPSH requirements throughout powered flight.

## 12 [REQ-PRS-02] Purge & spin-start gas supply
System shall supply spin-start and igniter gas to Propulsion at the pressure/flow required for each engine start event.

## 13 [REQ-PRS-03] Overpressure relief
Venting system shall prevent tank pressure from exceeding maximum allowable working pressure under worst-case heating.

## 14 [REQ-FED-01] Feed flow rate & pressure
Feed system shall deliver propellant to each engine's turbopump inlet within required flow rate and NPSH margin across throttle range.

## 15 [REQ-FED-02] Header tank switchover
Feed system shall switch source between main and header/landing tanks without interrupting engine flow.

## 16 [REQ-VLV-01] Valve leak-tightness & cycle life
Propellant, vent, and pressurization valves shall meet leak-tightness and cycle-life requirements for the qualified number of operations.

## 17 [REQ-GSE-01] Propellant loading rate
Ground interface shall support loading both propellants within the countdown's allotted fill time.

## 18 [REQ-GSE-02] Propellant densification
Ground interface shall deliver subcooled (densified) LOX and CH4 to increase loaded propellant mass for a given tank volume.

## 19 [REQ-GSE-03] Quick-disconnect release
Ground umbilical shall cleanly disconnect at liftoff without damaging vehicle-side plumbing.

## 20 [REQ-CTL-01] Leak & anomaly detection
System shall detect off-nominal tank pressure, level, or leak indications and report to Safety within a defined response time.

## 21 [REQ-CTL-02] Telemetry latency & bandwidth
Tank telemetry shall be sampled/transmitted at a rate sufficient for GNC delta-v estimation and Safety anomaly response.

## 22 [REQ-ENV-01] Vibroacoustic & thermal qualification
Tank-mounted valves, sensors, and controller electronics shall be qualified for the induced vibroacoustic and cryogenic thermal environment.