# Requirement set Requirements (R2025b)

## 1 [REQ-SYS-01] Liftoff thrust-to-weight margin
Liftoff thrust-to-weight ratio shall exceed vehicle gross liftoff weight by an adequate margin (typ. T/W ≥ 1.3).

## 2 [REQ-SYS-02] Engine-out mission continuation
Subsystem shall maintain controllability and mission-continuation with ≥1 main engine failed at any powered-flight point.

## 3 [REQ-SYS-03] Delta-v performance budget
Combined thrust × Isp × propellant mass shall meet the delta-v budget for the defined mission profile.

## 4 [REQ-QAL-01] Engine structural strength & life
Main engine structural elements shall meet strength and life (fatigue/creep) qualification margins.

## 5 [REQ-QAL-02] Pressurized component safety factor
Pressurized components shall meet metallic pressure vessel and COPV safety-factor requirements.

## 6 [REQ-QAL-03] Thrust mount & gimbal bearing safety factor
Thrust mounts and the gimbal bearing shall meet minimum design and test factors of safety for structural load paths carrying full engine thrust.

## 7 [REQ-TVC-01] Gimbal control authority
TVC shall null the maximum expected pitch and yaw disturbance torque with defined control margin. TVC provides no roll authority — roll is out of scope for this requirement (see REQ-ENG-02 for booster, REQ-RCS-01 for ship).

## 8 [REQ-TVC-02] Actuator torque margin
TVC actuators shall maintain positive torque margin against maximum expected disturbance loads.

## 9 [REQ-RCS-01] RCS attitude control authority (ship only)
Ship RCS shall provide full 3-axis attitude authority whenever main engines are off and aerosurfaces are ineffective, and shall provide roll-axis authority continuously — including during powered flight — since ship TVC provides pitch/yaw only. Booster carries no RCS; see REQ-ENG-02.

## 10 [REQ-RCS-02] RCS propellant budget margin
RCS propellant allocation shall include margin above the nominal attitude-control budget to cover contingency maneuvers (e.g. extended coast, off-nominal separation).

## 11 [REQ-IGN-01] Ignition reliability
Ignition system shall achieve reliable preburner light-off across the qualified inlet temperature / pressure range.

## 12 [REQ-VLV-01] Valve leak-tightness & cycle life
Propellant valves shall meet leak-tightness and cycle-life requirements for the qualified number of starts.

## 13 [REQ-CTL-01] Autonomous fault detection & shutdown
Engine controller shall detect off-nominal parameters and command safe shutdown within a defined response time.

## 14 [REQ-CTL-02] Telemetry latency & bandwidth
Engine telemetry shall be sampled and transmitted at a rate sufficient for Safety and fault mgmt to detect and react to an anomaly within the response time required by REQ-CTL-01.

## 15 [REQ-SYS-04] Propulsion dry mass budget
Total propulsion subsystem dry mass (engines, valves, controllers, TVC, RCS) shall not exceed the mass allocation set by the vehicle-level mass budget.

## 16 [REQ-ENV-01] Vibroacoustic qualification
Engine- and TVC-mounted electronics (controllers, actuators) shall be qualified to withstand the random vibration and acoustic environment induced during powered flight.

## 17 [REQ-CTL-03] EMI/EMC contro
Engine and RCS controller electronics shall meet conducted and radiated emissions/susceptibility limits to avoid interference with GNC and Communication.

## 18 [REQ-ENG-01] Multi-restart capability
Booster inner (gimbaling) engines and all ship main engines shall support ≥2 restarts per flight.

## 19 [REQ-ENG-02] Booster roll control via differential throttle
Booster shall achieve roll-axis control authority through coordinated differential throttling of engines offset from the roll axis (outer/inner ring); no booster engine gimbal contributes to roll, since gimbal deflection near the centerline produces negligible roll torque.